# Grasshopper definition Brandthaus_Robot_with_positioner.gh (Grasshopper 1.0.7)
# plug-ins: RobotComponentsABB, RobotComponentsEDEK

# ----
# Replace by three calibraction points.
# Use e.g. the controller utility components.
# Update the position in the controller configuration.
# The position in the controller, this Grasshopper file
# and the physical axis should match
number_slider = Slider(900, range=-10000..10000)
number_slider_2 = Slider(1800, range=-10000..10000)
number_slider_3 = Slider(-2000, range=-10000..10000)
pt = ConstructPoint(XCoordinate=number_slider_2, YCoordinate=number_slider_3, ZCoordinate=number_slider)
pt_2 = ConstructPoint(XCoordinate=number_slider_2, YCoordinate=number_slider_3, ZCoordinate=Slider(10000, range=-10000..10000))
pt_3 = ConstructPoint(XCoordinate=Slider(10000, range=-10000..10000), YCoordinate=number_slider_3, ZCoordinate=number_slider)
pt_4 = Point(pt_3)
pt_5 = Point(pt)
pt_6 = Point(pt_2)

merge = Merge(
    Data1=Slider(-15, range=-360..360),
    Data2=Slider(8, range=-360..360),
    Data3=Slider(6, range=-360..360),
    Data4=Slider(29, range=-360..360),
    Data5=Slider(4, range=-360..360),
    Data6=Slider(-31, range=-360..360))
merge_2 = Merge(Data1=Slider(-111, range=-360..360), Data2=Slider(3779, range=-5..9620))

# ----
# Track + Positioner + Robot
pl_3pt = Plane3Pt(PointA=pt_5, PointB=pt_6, PointC=pt_4)

# ----
# EDEK rule:
# The x-axis of the axis plane
# is always aligned with the z-axis
# of the world coordinate space
Z = UnitZ(Factor=1)
align = AlignPlane(Plane=pl_3pt, Direction=Z)  # -> Plane, Angle

# ----
# Values for controller configuration
ptoq = PlaneToQuaternion(Plane=pl_3pt, ReferencePlane=PlaneXY(0, 0, 0))  # -> CoordX, CoordY, CoordZ, QuaternionA, QuaternionB, QuaternionC, QuaternionD, String
panel = Panel(ptoq.CoordX)
panel_2 = Panel(ptoq.CoordZ)
panel_3 = Panel(ptoq.QuaternionA)
panel_4 = Panel(ptoq.QuaternionB)
panel_5 = Panel(ptoq.QuaternionC)
panel_6 = Panel(ptoq.QuaternionD)
panel_7 = Panel(ptoq.CoordY)

irbp_l300_l4000 = IRBPL300L4000(AxisPlane=align.Plane)
irb4600 = IRB460040255Platform(PositionPlane=PlaneXY(0, 0, 0), ExternalAxis=irbp_l300_l4000)

fk = ForwardKinematics(RobotInfo=irb4600, InternalAxisValues=merge, ExternalAxisValues=merge_2, Set_Hide_Mesh=False)  # -> PosedMeshes, EndPlane, ExternalAxisPlanes
