# Grasshopper definition Brandthaus_Robot_with_track.gh (Grasshopper 1.0.7)
# plug-ins: RobotComponentsABB, RobotComponentsEDEK

# ----
# This is not the final position.
# This has to be configured and decided later.
number_slider = Slider(-1000, range=-10000..10000)
pt = ConstructPoint(XCoordinate=Slider(-5000, range=-10000..10000), YCoordinate=number_slider, ZCoordinate=Slider(2500, range=-10000..10000))
xy = XYPlane(Origin=pt)
flip_plane_y = FlipPlaneY(Plane=xy)

# ----
# Track + Robot
gudel = GUDELTrack(AxisPlane=flip_plane_y)
irb4600 = IRB460040255(PositionPlane=PlaneXY(0, 0, 0), ExternalAxis=gudel)

merge = Merge(
    Data1=Slider(35, range=-360..360),
    Data2=Slider(75, range=-360..360),
    Data3=Slider(-137, range=-360..360),
    Data4=Slider(27, range=-360..360),
    Data5=Slider(22, range=-360..360),
    Data6=Slider(102, range=-360..360))
fk = ForwardKinematics(RobotInfo=irb4600, InternalAxisValues=merge, ExternalAxisValues=Slider(3778, range=-5..9620), Set_Hide_Mesh=False)  # -> PosedMeshes, EndPlane, ExternalAxisPlanes
