# Grasshopper definition Brandthaus_Robot_with_track_and_positioner.gh (Grasshopper 1.0.7)
# plug-ins: RobotComponentsABB, RobotComponentsEDEK

# ----
# This is not the final position.
# This has to be configured and decided later.
number_slider = Slider(-1000, range=-10000..10000)
pt = ConstructPoint(XCoordinate=Slider(-5000, range=-10000..10000), YCoordinate=number_slider, ZCoordinate=Slider(2500, range=-10000..10000))
xy = XYPlane(Origin=pt)
flip_plane_y = FlipPlaneY(Plane=xy)

# ----
# Replace by three calibraction points.
# Use e.g. the controller utility components.
# Update the position in the controller configuration.
# The position in the controller, this Grasshopper file
# and the physical axis should match
number_slider_2 = Slider(900, range=-10000..10000)
number_slider_3 = Slider(-3000, range=-10000..10000)
number_slider_4 = Slider(800, range=-10000..10000)
pt_2 = ConstructPoint(XCoordinate=number_slider_3, YCoordinate=number_slider_4, ZCoordinate=number_slider_2)
pt_3 = ConstructPoint(XCoordinate=number_slider_3, YCoordinate=number_slider_4, ZCoordinate=Slider(10000, range=-10000..10000))
pt_4 = ConstructPoint(XCoordinate=number_slider_3, YCoordinate=Slider(-10000, range=-10000..10000), ZCoordinate=number_slider_2)
pt_5 = Point(pt_4)
pt_6 = Point(pt_2)
pt_7 = Point(pt_3)

merge = Merge(
    Data1=Slider(-83, range=-360..360),
    Data2=Slider(76, range=-360..360),
    Data3=Slider(-122, range=-360..360),
    Data4=Slider(48, range=-360..360),
    Data5=Slider(38, range=-360..360),
    Data6=Slider(-12, range=-360..360))
merge_2 = Merge(Data1=Slider(-111, range=-360..360), Data2=Slider(3779, range=-5..9620))

# ----
# Track + Positioner + Robot
gudel = GUDELTrack(AxisPlane=flip_plane_y)
pl_3pt = Plane3Pt(PointA=pt_6, PointB=pt_7, PointC=pt_5)

# ----
# EDEK rule:
# The x-axis of the axis plane
# is always aligned with the z-axis
# of the world coordinate space
Z = UnitZ(Factor=1)
align = AlignPlane(Plane=pl_3pt, Direction=Z)  # -> Plane, Angle

# ----
# Values for controller configuration
ptoq = PlaneToQuaternion(Plane=align.Plane, ReferencePlane=PlaneXY(0, 0, 0))  # -> CoordX, CoordY, CoordZ, QuaternionA, QuaternionB, QuaternionC, QuaternionD, String
panel = Panel(ptoq.CoordX)
panel_2 = Panel(ptoq.CoordZ)
panel_3 = Panel(ptoq.QuaternionB)
panel_4 = Panel(ptoq.QuaternionC)
panel_5 = Panel(ptoq.QuaternionD)
panel_6 = Panel(ptoq.CoordY)
panel_7 = Panel(ptoq.QuaternionA)

irbp_l300_l4000 = IRBPL300L4000(AxisPlane=align.Plane)
merge_3 = Merge(Data1=irbp_l300_l4000, Data2=gudel)
irb4600 = IRB460040255(PositionPlane=PlaneXY(0, 0, 0), ExternalAxis=merge_3)

fk = ForwardKinematics(RobotInfo=irb4600, InternalAxisValues=merge, ExternalAxisValues=merge_2, Set_Hide_Mesh=False)  # -> PosedMeshes, EndPlane, ExternalAxisPlanes
