# Grasshopper definition Robotstudio_Robot_with_track_and_positioner.gh (Grasshopper 1.0.7)
# plug-ins: RobotComponentsABB, RobotComponentsEDEK

# ----
# Replace the calibraction points.
# Use e.g. the controller utility components.
# Update the position in the controller configuration.
# The position in the controller, this Grasshopper file
# and the physical axis should match
pt = Point(Point(199.1007619, 1303.593265, 454.8488987))
pt_2 = Point(Point(76.46913197, 1301.764163, 322.9607151))
pt_3 = Point(Point(264.9823079, 1304.669925, 282.0779026))
pt_4 = Point(Point(274.8714681, 1304.829593, 401.1521824))
pt_5 = Point(Point(86.95972492, 1301.843631, 401.0276097))
merge = Merge(Data1=pt, Data2=pt_2, Data3=pt_3, Data4=pt_4, Data5=pt_5)
plfit = PlaneFit(Points=merge)  # -> Plane, Deviation
fcircle = CircleFit(Points=merge)  # -> Circle, Radius, Deviation
deplane = DeconstructPlane(Plane=plfit.Plane)  # -> Origin, XAxis, YAxis, ZAxis
pl = ConstructPlane(Origin=fcircle.Circle, XAxis=deplane.XAxis, YAxis=deplane.YAxis)

# ----
# Aditional link mesh
number_slider = Slider(1000, range=0..1000)
Z = UnitZ(Factor=1)
line = LineSDL(Start=Point(0, 0, 0), Direction=Z, Length=number_slider)
pipe = Pipe(Curve=line, Radius=Slider(25, range=0..100), Caps=0)

# ----
# EDEK rule:
# The x-axis of the axis plane
# is always aligned with the z-axis
# of the world coordinate space
Z_2 = UnitZ(Factor=1)
align = AlignPlane(Plane=pl, Direction=Z_2)  # -> Plane, Angle

# ----
# Values for controller configuration
ptoq = PlaneToQuaternion(Plane=align.Plane, ReferencePlane=PlaneXY(0, 0, 0))  # -> CoordX, CoordY, CoordZ, QuaternionA, QuaternionB, QuaternionC, QuaternionD, String
panel = Panel(ptoq.CoordX)
panel_2 = Panel(ptoq.CoordY)
panel_3 = Panel(ptoq.CoordZ)
panel_4 = Panel(ptoq.QuaternionA)
panel_5 = Panel(ptoq.QuaternionB)
panel_6 = Panel(ptoq.QuaternionC)
panel_7 = Panel(ptoq.QuaternionD)

# ----
# Track + Positioner + Robot
igus = IGUSTrack()
igus_pos = IGUSPositioner(AxisPlane=align.Plane, LinkMesh=pipe)
merge_2 = Merge(Data1=flatten(igus), Data2=flatten(igus_pos))
irb1200 = IRB1200509(PositionPlane=PlaneXY(0, 0, 0), ExternalAxis=merge_2)

merge_3 = Merge(
    Data1=Slider(35, range=-360..360),
    Data2=Slider(44, range=-360..360),
    Data3=Slider(-9, range=-360..360),
    Data4=Slider(27, range=-360..360),
    Data5=Slider(22, range=-360..360),
    Data6=Slider(102, range=-360..360))
merge_4 = Merge(Data1=Slider(600, range=0..1150), Data2=Slider(-44, range=-360..360))
fk = ForwardKinematics(RobotInfo=irb1200, InternalAxisValues=merge_3, ExternalAxisValues=merge_4, Set_Hide_Mesh=False)  # -> PosedMeshes, EndPlane, ExternalAxisPlanes
