# Grasshopper definition IRB1200-5-090.gh (Grasshopper 1.0.7)
# plug-ins: RobotComponentsABB, RobotComponentsEDEK

# ----
# Name
# Robot mesh
panel = Panel("IRB1200-5/0.9")

pt = ConstructPoint(XCoordinate="0", YCoordinate="0", ZCoordinate="399.1")
vec = VectorXYZ(XComponent=Slider(0, range=0..1), YComponent=Slider(1, range=0..1), ZComponent=Slider(0, range=0..1))  # -> Vector, Length
pl = PlaneNormal(Origin=pt, ZAxis=vec.Vector)

vec_2 = VectorXYZ(XComponent=Slider(0, range=0..1), YComponent=Slider(0, range=0..1), ZComponent=Slider(1, range=0..1))  # -> Vector, Length
pt_2 = ConstructPoint(XCoordinate="0", YCoordinate="0", ZCoordinate="0")
pl_2 = PlaneNormal(Origin=pt_2, ZAxis=vec_2.Vector)

vec_3 = VectorXYZ(XComponent=Slider(1, range=0..1), YComponent=Slider(0, range=0..1), ZComponent=Slider(0, range=0..1))  # -> Vector, Length
pt_3 = ConstructPoint(XCoordinate="288.5", YCoordinate="0", ZCoordinate="399.1+448+42")
pl_3 = PlaneNormal(Origin=pt_3, ZAxis=vec_3.Vector)

vec_4 = VectorXYZ(XComponent=Slider(0, range=0..1), YComponent=Slider(1, range=0..1), ZComponent=Slider(0, range=0..1))  # -> Vector, Length
pt_4 = ConstructPoint(XCoordinate="451", YCoordinate="0", ZCoordinate="399.1+448+42")
pl_4 = PlaneNormal(Origin=pt_4, ZAxis=vec_4.Vector)

# ----
# Axis limits
panel_2 = Panel("70")
dom = ConstructDomain(DomainStart="-170", DomainEnd="170")
dom_2 = ConstructDomain(DomainStart="-100", DomainEnd="+130")
dom_3 = ConstructDomain(DomainStart="-200", DomainEnd=panel_2)
dom_4 = ConstructDomain(DomainStart="-270", DomainEnd="270")
dom_5 = ConstructDomain(DomainStart="-130", DomainEnd="130")
dom_6 = ConstructDomain(DomainStart="-400", DomainEnd="400")
merge = Merge(Data1=dom, Data2=dom_2, Data3=dom_3, Data4=dom_4, Data5=dom_5, Data6=dom_6)  # -> flatten(Result)

pt_5 = ConstructPoint(XCoordinate="0", YCoordinate="0", ZCoordinate="399.1+448")
vec_5 = VectorXYZ(XComponent=Slider(0, range=0..1), YComponent=Slider(1, range=0..1), ZComponent=Slider(0, range=0..1))  # -> Vector, Length
pl_5 = PlaneNormal(Origin=pt_5, ZAxis=vec_5.Vector)

vec_6 = VectorXYZ(XComponent=Slider(1, range=0..1), YComponent=Slider(0, range=0..1), ZComponent=Slider(0, range=0..1))  # -> Vector, Length
pt_6 = ConstructPoint(XCoordinate="451+82", YCoordinate="0", ZCoordinate="399.1+448+42")
pl_6 = PlaneNormal(Origin=pt_6, ZAxis=vec_6.Vector)

# ----
# Tool mounting frame
number_slider = Slider(1, range=0..1)
vec_7 = VectorXYZ(XComponent=number_slider, YComponent=Slider(0, range=0..1), ZComponent=Slider(0, range=0..1))  # -> Vector, Length
pt_7 = ConstructPoint(XCoordinate="451+82", YCoordinate="0", ZCoordinate="399.1+448+42")
pl_7 = PlaneNormal(Origin=pt_7, ZAxis=vec_7.Vector)
Z = UnitZ(Factor=1)
neg = Negative(Value=Z)
align = AlignPlane(Plane=pl_7, Direction=neg)  # -> Plane, Angle

# ----
# Position plane
number_slider_2 = Slider(500, range=0..4000)
pt_8 = ConstructPoint(XCoordinate=Slider(0, range=0..4000), YCoordinate=number_slider_2, ZCoordinate=Slider(0, range=0..4000))
xy = XYPlane(Origin=pt_8)

# ----
# Mesh settings
number_slider_3 = Slider(0, range=0..500)
custom_mesh_settings = SettingsCustom(
    StitchSeams=True,
    SimplePlanes=Toggle(True),
    Refine=Toggle(True),
    MinCount=Slider(0, range=0..50),
    MaxCount=Slider(0, range=0..50),
    AspectRatio=number_slider_3,
    MaxDistance=Slider(0, range=0..10),
    MaxAngle=Slider(0, range=0..360),
    MinEdge=Slider(0, range=0..20),
    MaxEdge=Slider(0, range=0..500))

# ----
# Axis planes
merge_2 = Merge(Data1=pl_2, Data2=pl, Data3=pl_5, Data4=pl_3, Data5=pl_4, Data6=pl_6)  # -> flatten(Result)

# ----
# Robot end-effector: for debugging purposes
number_slider_4 = Slider(20, range=0..200)
number_slider_5 = Slider(60, range=0..200)
xy_2 = XYPlane(Origin=Point(0, 0, 0))
cone = Cone(Base=xy_2, Radius=number_slider_4, Length=number_slider_5)  # -> Cone, Tip
Z_2 = UnitZ(Factor=number_slider_5)
mesh = Mesh(cone.Cone)
move = Move(Geometry=xy_2, Motion=Z_2)  # -> Geometry, Transform
robtoool = RobotToolFromPlanes(Name="debug_tool", Mesh=mesh, AttachmentPlane=xy_2, ToolPlane=move.Geometry)  # -> RobotTool, RobotToolCode

# ----
# Predefined robot info
irb1200 = IRB1200509(PositionPlane=xy, RobotTool=robtoool.RobotTool)

list = ValueList({"CUSTOM": 0, "PREDEFINED": 1}, selected="PREDEFINED")

pipeline = GeometryPipeline(
    GroupByLayer=False,
    GroupByType=False,
    IncludeHidden=True,
    IncludeLocked=True,
    LayerFilter="4",
    NameFilter="*",
    SublayerFiltering=True,
    TypeFilter=1073741848)
pipeline_2 = GeometryPipeline(
    GroupByLayer=False,
    GroupByType=False,
    IncludeHidden=True,
    IncludeLocked=True,
    LayerFilter="3",
    NameFilter="*",
    SublayerFiltering=True,
    TypeFilter=1073741848)
pipeline_3 = GeometryPipeline(
    GroupByLayer=False,
    GroupByType=False,
    IncludeHidden=True,
    IncludeLocked=True,
    LayerFilter="2",
    NameFilter="*",
    SublayerFiltering=True,
    TypeFilter=1073741848)
pipeline_4 = GeometryPipeline(
    GroupByLayer=False,
    GroupByType=False,
    IncludeHidden=True,
    IncludeLocked=True,
    LayerFilter="5",
    NameFilter="*",
    SublayerFiltering=True,
    TypeFilter=1073741848)
pipeline_5 = GeometryPipeline(
    GroupByLayer=False,
    GroupByType=False,
    IncludeHidden=True,
    IncludeLocked=True,
    LayerFilter="6",
    NameFilter="*",
    SublayerFiltering=True,
    TypeFilter=1073741848)
pipeline_6 = GeometryPipeline(
    GroupByLayer=False,
    GroupByType=False,
    IncludeHidden=True,
    IncludeLocked=True,
    LayerFilter="1",
    NameFilter="*",
    SublayerFiltering=True,
    TypeFilter=1073741848)
pipeline_7 = GeometryPipeline(
    GroupByLayer=False,
    GroupByType=False,
    IncludeHidden=True,
    IncludeLocked=True,
    LayerFilter="0",
    NameFilter="*",
    SublayerFiltering=True,
    TypeFilter=1073741848)
brep = Brep(pipeline_6)
brep_2 = Brep(pipeline_3)
brep_3 = Brep(pipeline_2)
brep_4 = Brep(pipeline)
brep_5 = Brep(pipeline_7)
brep_6 = Brep(pipeline_4)
brep_7 = Brep(pipeline_5)
mesh_2 = MeshBrep(Brep=brep, Settings=custom_mesh_settings)  # -> flatten(Mesh)
mesh_3 = MeshBrep(Brep=brep_2, Settings=custom_mesh_settings)  # -> flatten(Mesh)
mesh_4 = MeshBrep(Brep=brep_3, Settings=custom_mesh_settings)  # -> flatten(Mesh)
mesh_5 = MeshBrep(Brep=brep_6, Settings=custom_mesh_settings)  # -> flatten(Mesh)
mesh_6 = MeshBrep(Brep=brep_7, Settings=custom_mesh_settings)  # -> flatten(Mesh)
mjoin = MeshJoin(Meshes=mesh_2)
mjoin_2 = MeshJoin(Meshes=mesh_3)
mjoin_3 = MeshJoin(Meshes=mesh_4)
mjoin_4 = MeshJoin(Meshes=mesh_5)
mjoin_5 = MeshJoin(Meshes=mesh_6)

mesh_7 = Mesh(brep_4)
mesh_8 = Mesh(brep_5)

mjoin_6 = MeshJoin(Meshes=mesh_8)
mjoin_7 = MeshJoin(Meshes=mesh_7)
merge_3 = Merge(Data1=mjoin_6, Data2=mjoin, Data3=mjoin_2, Data4=mjoin_3, Data5=mjoin_7, Data6=mjoin_4, Data7=mjoin_5)  # -> flatten(Result)

# ----
# Mesh reduce
number_slider_6 = Slider(5000, range=0..10000)
merge_4 = Merge(
    Data1=number_slider_6,
    Data2=Slider(5000, range=0..10000),
    Data3=Slider(5000, range=0..10000),
    Data4=Slider(15000, range=0..15000),
    Data5=Slider(15000, range=0..15000),
    Data6=Slider(5000, range=0..10000),
    Data7=Slider(5000, range=0..10000))
python = GhPythonScript(mesh=merge_3, count=merge_4)  # -> out, mesh; inputs mesh: list of Mesh, count: list of Int32
# ---------- python: Python ----------
import Rhino.Geometry as rg

for i in range(len(mesh)):
    mesh[i].Reduce(count[i], True, 10, False)
# ---------- end python ----------

# ----
# Count mesh faces
demesh = DeconstructMesh(Mesh=python.mesh)  # -> Vertices, flatten(Faces), Colours, Normals
lng = ListLength(List=demesh.Faces)
panel_3 = Panel(lng)

# ----
# Binary formatter
# Convert mesh to string
# Convert string to mesh
rep = ReplaceText(Text=panel, Find="/", Replace="-", RecursiveReplace=False)
rep_2 = ReplaceText(Text=rep, Find=".", Replace="_", RecursiveReplace=False)
rep_3 = ReplaceText(Text=rep_2, Find="-", Replace="_", RecursiveReplace=False)
panel_4 = Panel(rep_3)
python_2 = GhPythonScript(meshes=python.mesh, name=panel_4, write=Button())  # -> out, text; inputs meshes: list of Mesh, write: Boolean
# ---------- python_2: Python ----------
import System
import os

import clr
clr.AddReference("RobotComponents.dll")
import RobotComponents.Utils.HelperMethods as helper

text = []
path = os.path.dirname(ghenv.Component.Attributes.Owner.OnPingDocument().FilePath)

for i in range(0, len(meshes)):
    text.append(System.Convert.ToBase64String(helper.ObjectToByteArray(meshes[i])))
    if write == True:
        filename = os.path.join(path, "{}_link_{}.txt".format(name, i))
        file = open(filename,'w+') 
        file.write(text[i]) 
        file.close()
# ---------- end python_2 ----------
text = Text(python_2.text)
number_slider_7 = Slider(0, range=0..6)  # disabled
item = ListItem(List=text, Index=number_slider_7, Wrap=True)  # disabled
python_3 = GhPythonScript(text=item)  # -> out, mesh; disabled
# ---------- python_3: Python ----------
import System
import Grasshopper
import os

import clr
clr.AddReference("RobotComponents.dll")
import RobotComponents.Utils.HelperMethods as helper

mesh = helper.ByteArrayToObject(System.Convert.FromBase64String(text))
# ---------- end python_3 ----------
mesh_9 = Mesh(python_3.mesh)  # disabled

# ----
# Robot info
robinfo = RobotInfo(
    Name=panel,
    Meshes=python.mesh,
    AxisPlanes=merge_2,
    AxisLimits=merge,
    PositionPlane=xy,
    MountingFrame=align.Plane,
    RobotTool=robtoool.RobotTool)

filter = StreamFilter(Gate=list, Stream0=robinfo, Stream1=irb1200)

# ----
# Deconstruct robot info and show axis planes
derobinfo = DeconstructRobotInfo(RobotInfo=filter)  # -> Name, Meshes, AxisPlanes, AxisLimits, PositionPlane, MountingFrame, ToolPlane, RobotTool, ExternalAxis
pv = PlaneVisualizer(Plane=derobinfo.AxisPlanes)

# ----
# Forward kinematics
number_slider_8 = Slider(57, range=-180..180)
merge_5 = Merge(
    Data1=Slider(-29, range=-180..180),
    Data2=Slider(57, range=-180..180),
    Data3=Slider(-23, range=-180..180),
    Data4=Slider(67, range=-180..180),
    Data5=number_slider_8,
    Data6=Slider(-156, range=-180..180))  # -> flatten(Result)
fk = ForwardKinematics(RobotInfo=filter, InternalAxisValues=merge_5, ExternalAxisValues=[0, 0, 0, 0, 0, 0], Set_Hide_Mesh=False)  # -> PosedMeshes, EndPlane, ExternalAxisPlanes
pv_2 = PlaneVisualizer(Plane=fk.EndPlane)
